# Grasshopper definition Screen_Tilt.gh (Grasshopper 1.0.7)
# plug-ins: LunchBox

xy = XYPlane(Origin=Point(0, 0, 0))
xz = XZPlane(Origin=Point(0, 0, 0))
rectangle = Rectangle(Plane=xy, XSize=Slider(19, range=0..100), YSize=Slider(7, range=0..10), Radius=0)  # -> Rectangle, Length
number_slider = Slider(2, range=0..10)
rotationangle = Slider(36, range=1..36, expression="x*5")
rotationangle_2 = Slider(180, range=0..180)
aperturescale = Slider(0.43, range=0..0.99)
rotationangle_3 = GetNumber(rotationangle_2, AtLeast=1, AtMost=2147483647, Maximum=1.797693135e+308, Minimum=-1.797693135e+308)
number_slider_2 = Slider(3243, range=0..10000)
aperturescale_2 = GetNumber(aperturescale, AtLeast=1, AtMost=2147483647, Maximum=1.797693135e+308, Minimum=-1.797693135e+308)
dom = ConstructDomain(DomainStart=Slider(0.01, range=0.01..1), DomainEnd=aperturescale_2)
dom_2 = ConstructDomain(DomainStart=Slider(0.92, range=0..1), DomainEnd=Slider(0.03, range=0..1))
number_slider_3 = Slider(20, range=0..10000)  # disabled
Y = UnitY(Factor=number_slider_3)  # disabled

boundary_curve = Curve(rectangle.Rectangle)
crv = Curve()

debrep = DeconstructBrep(Brep=boundary_curve)  # -> Faces, Edges, Vertices
bang = ExplodeTree(Data=graft(debrep.Edges))  # -> Branch0, Branch1, Branch2, Branch3
number_slider_4 = Slider(24, range=0..100)
curvepoint = PointOnCurve(bang.Branch3, parameter=0.5)
curvepoint_2 = PointOnCurve(bang.Branch1, parameter=0.5)
ln = Line(StartPoint=curvepoint, EndPoint=curvepoint_2)
range = Range(Domain=Domain(0, 1), Steps=number_slider_4)
divide = DivideCurve(Curve=ln, Count=number_slider_4, Kinks=False)  # -> Points, Tangents, Parameters
graph = GraphMapper(range, x0=0, x1=-1, y0=0, y1=1, container_name="Sine", Equation_px=[0, 0.507895112], Equation_py=[0, 0.9974124432])
neg = Negative(Value=number_slider)
dom_3 = ConstructDomain(DomainStart=number_slider, DomainEnd=neg)
remap = RemapNumbers(Value=graph, Source=Domain(0, 1), Target=graft(dom_3))  # -> Mapped, Clipped
Z = UnitZ(Factor=remap.Mapped)
move = Move(Geometry=divide.Points, Motion=Z)  # -> Geometry, Transform
intcrv = Interpolate(Vertices=move.Geometry, Degree=3, Periodic=False, KnotStyle=1)  # -> Curve, Length, Domain

attractor_crv = Curve(intcrv.Curve)

merge = Merge(Data1=attractor_crv, Data2=crv)
area = Area(Geometry=boundary_curve)  # -> Area, Centroid
xz_2 = XZPlane(Origin=area.Centroid)
srf = Surface(boundary_curve)
rotate = Rotate(Geometry=attractor_crv, Angle=degrees(rotationangle_3), Plane=xz_2)  # -> Geometry, Transform
trib = TrianglePanelsB(Surface=srf, UDivisions=Slider(54, range=0..100), VDivisions=Slider(34, range=0..100))
area_2 = Area(Geometry=trib)  # -> Area, Centroid
pull = PullPoint(Point=area_2.Centroid, Geometry=rotate.Geometry, ClosestOnly=True)  # -> ClosestPoint, Distance
min = Minimum(A=pull.Distance, B=Slider(5, range=0..10))
panel = Panel(min)
bnd = Bounds(Numbers=min)
remap_2 = RemapNumbers(Value=min, Source=bnd, Target=dom)  # -> Mapped, Clipped
scale = Scale(Geometry=trib, Center=area_2.Centroid, Factor=remap_2.Mapped)  # -> Geometry, Transform

# ----
# Less Compute time - larger file size in Rh
crv_2 = Curve(graft(trib))
crv_3 = Curve(graft(scale.Geometry))
merge_2 = Merge(Data1=crv_2, Data2=crv_3)
boundary = BoundarySurfaces(Edges=merge_2)  # disabled
extr = Extrude(Base=boundary, Direction=Y)  # disabled

# ----
# More Compute time - smaller file size in Rh
crv_4 = Curve(flatten(scale.Geometry))
crv_5 = Curve(boundary_curve)
merge_3 = Merge(Data1=crv_5, Data2=crv_4)
boundary_2 = BoundarySurfaces(Edges=merge_3)  # disabled
extr_2 = Extrude(Base=boundary_2, Direction=Y)  # disabled

screen_centre_pt = Point(area.Centroid)
area_3 = Area(Geometry=merge_3)  # -> Area, Centroid
pull_2 = PullPoint(Point=area_3.Centroid, Geometry=screen_centre_pt, ClosestOnly=True)  # -> ClosestPoint, Distance
len = Length(Curve=merge_3)
bnd_2 = Bounds(Numbers=pull_2.Distance)
remap_3 = RemapNumbers(Value=pull_2.Distance, Source=bnd_2, Target=Domain(0, 1))  # -> Mapped, Clipped
cull_i = CullIndex(List=area_3.Area, Indices="0", Wrap=True)
cull_i_2 = CullIndex(List=len, Indices="0", Wrap=True)
gradient = Gradient(
    LowerLimit=0,
    UpperLimit=1,
    Parameter=remap_3.Mapped,
    stops=[0: RGB(0, 34, 255), 0.5: RGB(255, 0, 85), 1: RGB(255, 153, 0)])
gradient_2 = Gradient(
    LowerLimit=0,
    UpperLimit=1,
    Parameter=remap_3.Mapped,
    stops=[0: RGB(0, 98, 0), 0.25: RGB(81, 175, 17), 0.5: RGB(159, 198, 146), 0.75: RGB(170, 235, 41), 1: RGB(221, 255, 53)])
num = Number(cull_i_2)
num_2 = Number(cull_i)
c_script = CSharpScript(crv=merge_3, color=gradient, length=num, area=num_2)  # -> out, A, B, C; inputs crv: Curve, color: Color, length: String, area: String
# ---------- c_script: C# ----------
    var c = color.R + "," + color.G + "," + color.B;
    crv.SetUserString("color", c);
    A = crv;
    var d = length;
    crv.SetUserString("length", d);
    B = length;
    var e = area;
    crv.SetUserString("area", e);
    C = area;
# ---------- end c_script ----------
panel_2 = Panel(c_script.C)
panel_3 = Panel(c_script.B)

# ---- group: RH_OUT:edges
curve = Curve(flatten(c_script.A))
